# Grasshopper definition villa.gh (Grasshopper 0.9.76)
# plug-ins: Kangaroo Components, TT Toolbox

archivo_excel = Text("C:\Users\pablo rey\Desktop\artinumero.xls")
readxl = ReadExcelSheet(Run=Toggle(True), FilePath=archivo_excel, Worksheet="1", Listen=Toggle(True))  # -> UserMessages, Columns, Rows

intervalos = Slider(19, range=-1..160)
timer = Timer(TimerInterval=1000, Target=counter)
counter = Counter(Reset=Toggle(True))
tbi = TreeBranchIndex(DataTree=readxl.Rows, BranchIndex=counter)
panel = Panel(tbi)
txt = Text("cm")
rep = ReplaceText(Text=panel, Find=txt, RecursiveReplace=False)

panel_2 = Panel(rep)
divisiones = Slider(20, range=0..40)
patch = Patch(Spans=divisiones, Flexibility=Slider(40, range=0..100), Trim=True)

Z = UnitZ(Factor=panel_2)
pt = Point([<point referenced from the Rhino model> x14])
pt_2 = PointOriented(BasePlane=pt, UComponent=0, VComponent=0, WComponent=Z)

del = DelaunayMesh(Points=pt_2, Plane=PlaneXY(0, 0, 0))
con = DelaunayEdges(Points=pt_2, Plane=PlaneXY(0, 0, 0))  # -> Connectivity, Edges
